# Grasshopper definition import bodies_iso.gh (Grasshopper 0.9.76)
# Copyright: Co-de-iT
# plug-ins: MarchingCubes, Human, Mesh Pipe

file = ReadFile(
    File="F:\Users\alessio\Documents\Processing\sketches\@ Pheromonics 2.0\Agent_Body\export_data\2155Y_struct.txt",
    PerLineParse=True)
point_separator_space = Panel(" ")
split = TextSplit(Text=file, Separators=point_separator_space)
split_2 = SplitList(List=split, Index="1")  # -> ListA, ListB
pt = Point(split_2.ListA)
pt_2 = Point(split_2.ListB)
ln = Line(StartPoint=pt, EndPoint=pt_2)  # -> flatten(Line)
join = JoinCurves(Curves=ln, Preserve=False)
mpipe = MeshPipe(Curve=join, Radius=Slider(1, range=0.01..1), Accuracy=0.2, Rotation=0, Segments="3", Caps=2)
mjoin = MeshJoin(Meshes=mpipe)
previewmat = CustomPreviewMaterials(Geometry=mjoin, DiffuseColor=RGB(255, 255, 255))

curve_charge = CurveCharge(Curve=join, Radius=Slider(2, range=0..3), ChargeStrengths=Slider(1, range=0..1))
cocoon = Cocoon(Charges=curve_charge, Iso=Slider(0.15, range=0..1), CellSize=Slider(2, range=1..20), Execute=Toggle(False), Simple=False)  # -> Mesh, RefinementData
# cocoon isomesh
refine = Refine(
    RefinementData=cocoon.RefinementData,
    Samples=Slider(3, range=1..10),
    SampleSize=Slider(0.25, range=0..1),
    SampleTolerance=Slider(0.25, range=0..1),
    LaplacianSmoothing=Slider(1, range=1..5),
    ValencePasses=Slider(1, range=1..10),
    SubD=Slider(1, range=1..3),
    Execute=Toggle(False))
mjoin_2 = MeshJoin(Meshes=refine)
previewmat_2 = CustomPreviewMaterials(Geometry=mjoin_2, DiffuseColor=RGB(255, 255, 255))
