# Grasshopper definition 1_0_0_export mesh_v2.gh (Grasshopper 0.9.76)
# Copyright: Co-de-iT
# plug-ins: Weaverbird
# STL import, color and color tabe output for Processing

custom_subdir = Panel("GH_2_P5/data")
# save your mesh as .stl with this filename
# 
# (in Rhino: File > Export Selected)
file_name_extension = Panel("spheres_fused.stl")
dir_type = ValueList({"desktop": 0, "documents": 1, "GH file path": 2, "C:": 3}, selected="GH file path")
# NOTE
# Import the mesh in Rhino, weld
# and export as STL. Then use the
# welded and reference it in GH.
# mesh from Rhino
# reference here your mesh from Rhino
mesh = Mesh(<mesh referenced from the Rhino model>)
wbjoin = WeaverbirdsJoinMeshesAndWeld(Mesh=mesh, Weld=Toggle(True))
f_pathg = PathGenerator(type=dir_type, subDir=custom_subdir)  # -> dir; inputs type: Int32, subDir: String
# ---------- f_pathg: C# ----------
                           /*
    froGH - a sparse collection of (in)utilities for Grasshopper

    Path Generator
    code by Alessio Erioli - value list generation based on code by James Ramsden

    froGH by Co-de-iT is licensed under a Creative Commons Attribution 4.0 International License.
    http://creativecommons.org/licenses/by/4.0/

    */
    initComp();


    String S = "";
    String root = "";
    String end = "\\";
    String eol = Environment.NewLine;

    // __________________ autoList part __________________

    // variable for the list
    Grasshopper.Kernel.Special.GH_ValueList vList;
    // tries to cast input as list
    try{

      // if the list is not the first parameter then change Input[0] to the corresponding value
      vList = (Grasshopper.Kernel.Special.GH_ValueList) Component.Params.Input[0].Sources[0];
      // Print("value list connected");
      // check if the list must be created
      //if (vList.NickName != "dir type"){
      if (!vList.NickName.Equals("dir type")){
        vList.ClearData();
        vList.ListItems.Clear();
        vList.NickName = "dir type";
        var item1 = new Grasshopper.Kernel.Special.GH_ValueListItem("desktop", "0");
        var item2 = new Grasshopper.Kernel.Special.GH_ValueListItem("documents", "1");
        var item3 = new Grasshopper.Kernel.Special.GH_ValueListItem("GH file path", "2");
        var item4 = new Grasshopper.Kernel.Special.GH_ValueListItem("C:", "3");
        vList.ListItems.Add(item1);
        vList.ListItems.Add(item2);
        vList.ListItems.Add(item3);
        vList.ListItems.Add(item4);

        vList.ListItems[0].Value.CastTo(out type);
      }
    }
    catch{
      // handles anything that is not a value list
    }


    switch(type){
      case 0:
        root = Environment.GetFolderPath(Environment.SpecialFolder.Desktop) + end;
        S = "Desktop";
        break;
      case 1:
        root = Environment.GetFolderPath(Environment.SpecialFolder.MyDocuments) + end;
        S = "Documents";
        break;
      case 2:
        GH_Document ghDoc = owner.OnPingDocument();

        if (ghDoc.IsFilePathDefined)
        {
          int nameLen = ghDoc.DisplayName.TrimEnd('*').Length + 3; // +3 accounts for the '.gh' extension
          int fileLen = ghDoc.FilePath.TrimEnd('*').Length;

          //F = ghDoc.DisplayName.TrimEnd('*');
          root = ghDoc.FilePath.Substring(0, fileLen - nameLen);
          //root = gh_d.FilePath;
          S = "GH File path";
        }
        else
        {
          Print("No path defined. Saving to Desktop until then");
          root = Environment.GetFolderPath(Environment.SpecialFolder.Desktop);
          S = "Desktop";
        }
        break;
      case 3:
        root = "C:" + end;
        S = root + end;
        break;
    }
    dir = root + (subDir != null ? (subDir + end) : "");
    Component.Message = S;
# ---------- f_pathg: C# additional code ----------
  void initComp(){
    Component.Name = "Path Generator";
    Component.NickName = "f_PathG";
    Component.Description = "generates a path based on local direcories such as Desktop, Documents, GH file path";
    Component.Params.Input[0].Name = "dir type";
    Component.Params.Input[0].Description = "directory type: 0 desktop, 1 documents, 2 GH file path, 3 C:\nconnect a value list for automatic list generation";
    Component.Params.Input[1].Name = "custom subdir";
    Component.Params.Input[1].Description = "(optional) custom subdirectory";
  }
# ---------- end f_pathg ----------
txt = Text(file_name_extension)
# Save mesh Vertex color to File
# 
# Exports a vertex color text file. Automatically reads your user directory and finds its way to Desktop. Doc folder, sketch folder or C drive.
# 
# code by Alessio Erioli
# 
# v 1.0
# 
# © Co-de-iT 2017 _ Creative Commons Attribution-NonCommercial-ShareAlike 4.0 International License
# <WS NAME>
# <subtitle>
# tutor: <tutor name | es. Alessio Erioli>
# <place> . <date>
# Workflows/@ reference geometries/sample geometries.3dm
# NOTE
# 
# save your STL mesh in the subfolder:
# 
# GH_2_P5/data
# NOTE
# it MUST be the same name+extension
# of the mesh used in Processing
file_name_extension_2 = Panel("spheres_fused.stl")
file_name_extension_for_color_table = Panel("_vCols.txt")
split = TextSplit(Text=txt, Separators=".")

merge = Merge(
    Data1=ColourSwatch(SwatchColor=RGB(255, 191, 0)),
    Data2=ColourSwatch(SwatchColor=RGB(255, 255, 255)),
    Data3=ColourSwatch(SwatchColor=RGB(41, 163, 161)),
    Data4=ColourSwatch(SwatchColor=RGB(0, 0, 0)),
    Data5=ColourSwatch(SwatchColor=RGB(240, 0, 0)))
pt = Point([Point(-124.1038765, 128.4457504, -1.399957994), Point(-145.2338695, -107.507681, -84.4730952), Point(1.287624492, 1.84067972, 129.8389128), Point(126.8280025, 149.1185695, 1.032362402), Point(177.8120932, -152.8450227, -18.77745361)])
mspray = MeshSpray(Mesh=wbjoin, Points=pt, Colours=merge, SprayMode=11)
demesh = DeconstructMesh(Mesh=mspray)  # -> Vertices, Faces, Colours, Normals
X = UnitX(Factor=Slider(500, range=1..500))
move = Move(Geometry=mspray, Motion=X)  # -> Geometry, Transform

item = ListItem(List=split, Index=0, Wrap=True)
txt_2 = Text(file_name_extension_2)
concat = Concatenate(FragmentA=item, FragmentB=file_name_extension_for_color_table)

# ---- group: attractors
pt_2 = Point([Point(-124.1038765, 128.4457504, -1.399957994), Point(-145.2338695, -107.507681, -84.4730952), Point(1.287624492, 1.84067972, 129.8389128), Point(126.8280025, 149.1185695, 1.032362402), Point(177.8120932, -152.8450227, -18.77745361)])

# ----
# color by attractors
demesh_2 = DeconstructMesh(Mesh=wbjoin)  # -> Vertices, Faces, Colours, Normals
frequency = Slider(0.05, range=0..1)
sinatt = SinusoidAttractor(points=demesh_2.Vertices, attractors=pt_2, frequency=frequency)
# use greyscale for stigmergic map
gradient = Gradient(LowerLimit=0, UpperLimit=1, Parameter=sinatt, stops=[0: RGB(145, 145, 145), 1: RGB(0, 0, 0)])
conmesh = ConstructMesh(Vertices=demesh_2.Vertices, Faces=demesh_2.Faces, Colours=gradient)

custom_subdir_2 = Panel("GH_2_P5/data")
file_name_extension_for_color_table_2 = Panel("_vCols.txt")
dir_type_2 = ValueList({"desktop": 0, "documents": 1, "GH file path": 2, "C:": 3}, selected="GH file path")
split_2 = TextSplit(Text=txt_2, Separators=".")
destination_directory = Panel(f_pathg)
output_file_name_extension = Panel(concat)
concat_2 = Concatenate(FragmentA=f_pathg, FragmentB=concat)
merge_2 = Merge(
    Data1=Slider(1, range=0..1),
    Data2=Slider(0.517, range=0..1),
    Data3=Slider(1, range=0..1),
    Data4=Slider(0.517, range=0..1),
    Data5=Slider(1, range=0..1))
item_2 = ListItem(List=split_2, Index=0, Wrap=True)
f_pathg_2 = PathGenerator(type=dir_type_2, subDir=custom_subdir_2)  # -> dir; inputs type: Int32, subDir: String; same code as f_pathg
destination_directory_2 = Panel(f_pathg_2)
concat_3 = Concatenate(FragmentA=item_2, FragmentB=file_name_extension_for_color_table_2)
sinatt_2 = SinusoidAttractor_2(points=demesh_2.Vertices, attractors=pt_2, charge=merge_2, frequency=Slider(2817.597, range=0..5000))
output_file_name_extension_2 = Panel(concat_3)
concat_4 = Concatenate(FragmentA=f_pathg_2, FragmentB=concat_3)

# ----
# export Vertex Color Map
# put to false in case
# of unwelded mesh
# (will save also corresponding point position)
color_only = BooleanToggle(True)
save = Button()
colxp = ColorTableExporter(P=demesh_2.Vertices, C=gradient, co=color_only, F=concat_4, s=save)  # -> Ct; inputs P: list of Point3d, C: list of Int32, co: Boolean, F: String, s: Boolean
#   port s: Saves the color table input a button to trigger saving
# ---------- colxp: C# ----------
                                                                            /*
    color exporter v 1.0
    (c) Co-de-iT 2017
    */

    initComp();

    String ss = "", sep = "_";
    List<String> vertices = new List <String>();
    if (co){
      for (int k = 0; k < C.Count; k++){
        ss = "";
        ss += C[k].ToString();
        vertices.Add(ss);
      }
    }else{
      for (int k = 0; k < P.Count; k++){
        ss = "";
        ss += P[k].X.ToString() + "," + P[k].Y.ToString() + "," + P[k].Z.ToString();
        ss += sep + C[k].ToString();
        vertices.Add(ss);
      }
    }

    if (s) System.IO.File.WriteAllLines(F, vertices);

    Ct = vertices;
# ---------- colxp: C# additional code ----------
  void initComp(){
    Component.Name = "Color Table Exporter";
    Component.NickName = "ColXp";
    Component.Description = "Exports color table for meshes\njust colors or colors+points";
    Component.Params.Input[0].Name = "Point list";
    Component.Params.Input[0].Description = "List of points associated with colors\n(optional if color only is selected)";
    Component.Params.Input[1].Name = "Color list";
    Component.Params.Input[1].Description = "List of colors";
    Component.Params.Input[2].Name = "Color only";
    Component.Params.Input[2].Description = "True if you need only to save colors";
    Component.Params.Input[3].Name = "File path";
    Component.Params.Input[3].Description = "File name and path to save";
    Component.Params.Input[4].Name = "Save";
    Component.Params.Input[4].Description = "Saves the color table\ninput a button to trigger saving";
    Component.Params.Output[0].Name = "Color Table";
    Component.Params.Output[0].Description = "The data inside the color table file";
  }
# ---------- end colxp ----------
exported_data = Panel(colxp)

# ----
# export Vertex Color Map
# put to false in case
# of unwelded mesh
# (will save also corresponding point position)
color_only_2 = BooleanToggle(True)
save_2 = Button()
colxp_2 = ColorTableExporter(P=demesh.Vertices, C=demesh.Colours, co=color_only_2, F=concat_2, s=save_2)  # -> Ct; inputs P: list of Point3d, C: list of Int32, co: Boolean, F: String, s: Boolean; same code as colxp
exported_data_2 = Panel(colxp_2)

# ==== cluster SinusoidAttractor: Gives sinusoid data based on attractor point(s) distance
attractors = ClusterInput()
points = ClusterInput()
frequency = ClusterInput()
dist = Distance(PointA=graft(points), PointB=attractors)
sort = SortList(Keys=dist)  # -> Keys, ValuesA
item = ListItem(List=sort.Keys, Index=0, Wrap=True)
multiplication = Multiplication(A=item, B=frequency)
sin = Sine(Value=multiplication)  # -> flatten(Result)
bnd = Bounds(Numbers=flatten(sin))
remap = RemapNumbers(Value=sin, Source=bnd, Target=Domain(0, 1))  # -> Mapped, Clipped
distance_data = ClusterOutput(remap.Mapped)

# ==== cluster SinusoidAttractor_2: Sinusoid attractor component
attractors = ClusterInput()
points = ClusterInput()
charge = ClusterInput()  # Attractor point charge 0-1 (1 value for each point)
frequency = ClusterInput()
dist = Distance(PointA=graft(points), PointB=attractors)
multiplication = Multiplication(A=dist, B=charge)
sort = SortList(Keys=dist)  # -> Keys, ValuesA; disabled
one_over_x = OneOverX(Value=multiplication)
item = ListItem(List=sort.Keys, Index=0, Wrap=True)  # disabled
avr = Average(Input=one_over_x)
multiplication_2 = Multiplication(A=avr, B=frequency)
sin = Sine(Value=multiplication_2)  # -> flatten(Result)
bnd = Bounds(Numbers=flatten(sin))
remap = RemapNumbers(Value=sin, Source=bnd, Target=Domain(0, 1))  # -> Mapped, Clipped
distance_data = ClusterOutput(remap.Mapped)
