# Grasshopper definition 1_0_1-1_field on mesh_Millipede.gh (Grasshopper 0.9.76)
# Copyright: Co-de-iT
# plug-ins: Millipede

mesh = Mesh(<mesh referenced from the Rhino model>)

geo = Geometry(<curve referenced from the Rhino model>)
geo_2 = Geometry(<point referenced from the Rhino model>)
mcomp = Decompose(Mesh=mesh)  # -> Vertices, Faces, Colours, Normals
pull = PullPoint(Point=mcomp.Vertices, Geometry=geo, ClosestOnly=True)  # -> ClosestPoint, Distance
pull_2 = PullPoint(Point=mcomp.Vertices, Geometry=geo_2, ClosestOnly=True)  # -> ClosestPoint, Distance
division = Division(A=pull.Distance, B=pull_2.Distance)
subtraction = Subtraction(A=pull.Distance, B=pull_2.Distance)
multiplication = Multiplication(A=subtraction, B=Slider(0.2, range=0..1))
atan = ArcTangent(Value=division)
n_curves = Slider(33, range=1..60)
bnd = Bounds(Numbers=atan)
range = Range(Domain=bnd, Steps=n_curves)

preview = CustomPreview(Geometry=mesh, Shader=ColourSwatch(SwatchColor=RGB(255, 255, 255)))

mesh_contours = MeshContourField(Mesh=mesh, Values=atan, IsoValues=flatten(range))
join = JoinCurves(Curves=flatten(mesh_contours), Preserve=False)

number_slider = Slider(8, range=0..10)
item = ListItem(List=join, Index=0, Wrap=True)
demesh = DeconstructMesh(Mesh=mesh)  # -> Vertices, Faces, Colours, Normals
flip = FlipCurve(Curve=join, Guide=item)  # -> Curve, Flag
divlength = DivideLength(Curve=flip.Curve, Length=Slider(20, range=10..200))  # -> Points, Tangents, Parameters
cp = ClosestPoint(Point=demesh.Vertices, Cloud=flatten(divlength.Points))  # -> ClosestPoint, CPIndex, Distance
multiplication_2 = Multiplication(A=divlength.Tangents, B=number_slider)
item_2 = ListItem(List=flatten(divlength.Tangents), Index=cp.CPIndex, Wrap=True)
multiplication_3 = Multiplication(A=item_2, B=number_slider)
# field on curves
vdisex = VectorDisplayEx(Point=divlength.Points, Vector=multiplication_2, Colour=RGB(0, 0, 0), Width=2)
# field on mesh vertices
vdisex_2 = VectorDisplayEx(Point=demesh.Vertices, Vector=multiplication_3, Colour=ColourSwatch(SwatchColor=RGB(199, 199, 199)), Width=2)

# ---- group: pts
pt = Point(flatten(divlength.Points))

# ---- group: vectors
vec = Vector(flatten(divlength.Tangents))
