# Grasshopper definition 1_0_1_export field-agents.gh (Grasshopper 0.9.76)
# Copyright: Co-de-iT
# plug-ins: Human

number_slider = Slider(40, range=10..100)
# mesh from stl file
dir_type = ValueList({"desktop": 0, "documents": 1, "GH file path": 2, "C:": 3}, selected="GH file path")
custom_subdir = Panel("GH_2_P5\data")
file_name_extension = Panel("spheres_fused.stl")
random = Random(Range="-1 to 1", Number=number_slider, Seed=2)
f_pathg = PathGenerator(type=dir_type, subDir=custom_subdir)  # -> dir; inputs type: Int32, subDir: String
# ---------- f_pathg: C# ----------
                           /*
    froGH - a sparse collection of (in)utilities for Grasshopper

    Path Generator
    code by Alessio Erioli - value list generation based on code by James Ramsden

    froGH by Co-de-iT is licensed under a Creative Commons Attribution 4.0 International License.
    http://creativecommons.org/licenses/by/4.0/

    */
    initComp();


    String S = "";
    String root = "";
    String end = "\\";
    String eol = Environment.NewLine;

    // __________________ autoList part __________________

    // variable for the list
    Grasshopper.Kernel.Special.GH_ValueList vList;
    // tries to cast input as list
    try{

      // if the list is not the first parameter then change Input[0] to the corresponding value
      vList = (Grasshopper.Kernel.Special.GH_ValueList) Component.Params.Input[0].Sources[0];
      // Print("value list connected");
      // check if the list must be created
      //if (vList.NickName != "dir type"){
      if (!vList.NickName.Equals("dir type")){
        vList.ClearData();
        vList.ListItems.Clear();
        vList.NickName = "dir type";
        var item1 = new Grasshopper.Kernel.Special.GH_ValueListItem("desktop", "0");
        var item2 = new Grasshopper.Kernel.Special.GH_ValueListItem("documents", "1");
        var item3 = new Grasshopper.Kernel.Special.GH_ValueListItem("GH file path", "2");
        var item4 = new Grasshopper.Kernel.Special.GH_ValueListItem("C:", "3");
        vList.ListItems.Add(item1);
        vList.ListItems.Add(item2);
        vList.ListItems.Add(item3);
        vList.ListItems.Add(item4);

        vList.ListItems[0].Value.CastTo(out type);
      }
    }
    catch{
      // handles anything that is not a value list
    }


    switch(type){
      case 0:
        root = Environment.GetFolderPath(Environment.SpecialFolder.Desktop) + end;
        S = "Desktop";
        break;
      case 1:
        root = Environment.GetFolderPath(Environment.SpecialFolder.MyDocuments) + end;
        S = "Documents";
        break;
      case 2:
        GH_Document ghDoc = owner.OnPingDocument();

        if (ghDoc.IsFilePathDefined)
        {
          int nameLen = ghDoc.DisplayName.TrimEnd('*').Length + 3; // +3 accounts for the '.gh' extension
          int fileLen = ghDoc.FilePath.TrimEnd('*').Length;

          //F = ghDoc.DisplayName.TrimEnd('*');
          root = ghDoc.FilePath.Substring(0, fileLen - nameLen);
          //root = gh_d.FilePath;
          S = "GH File path";
        }
        else
        {
          Print("No path defined. Saving to Desktop until then");
          root = Environment.GetFolderPath(Environment.SpecialFolder.Desktop);
          S = "Desktop";
        }
        break;
      case 3:
        root = "C:" + end;
        S = root + end;
        break;
    }
    dir = root + (subDir != null ? (subDir + end) : "");
    Component.Message = S;
# ---------- f_pathg: C# additional code ----------
  void initComp(){
    Component.Name = "Path Generator";
    Component.NickName = "f_PathG";
    Component.Description = "generates a path based on local direcories such as Desktop, Documents, GH file path";
    Component.Params.Input[0].Name = "dir type";
    Component.Params.Input[0].Description = "directory type: 0 desktop, 1 documents, 2 GH file path, 3 C:\nconnect a value list for automatic list generation";
    Component.Params.Input[1].Name = "custom subdir";
    Component.Params.Input[1].Description = "(optional) custom subdirectory";
  }
# ---------- end f_pathg ----------

crv = Curve(reparameterize(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))
# field generator
curve_s = ValueList({"curve(to poly)": 0, "single polyline": 1, "multiple polylines": 2}, selected="multiple polylines")
crv_2 = Curve(reparameterize([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]))
crv_3 = Curve(reparameterize(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))
divide = DivideCurve(Curve=crv, Count=Slider(71, range=10..100), Kinks=False)  # -> Points, Tangents, Parameters
pline = PolyLine(Vertices=divide.Points, Closed=False)
filter = StreamFilter(Gate=curve_s, Stream0=pline, Stream1=crv_3, Stream2=crv_2)

# ----
# mesh from Rhino
panel = Panel("180")
concat = Concatenate(FragmentA=f_pathg, FragmentB=file_name_extension)
rad = Radians(Degrees=panel)
stlimp = STLImport(F=concat, wA=rad)  # -> info, M; inputs F: String, wA: Double
# ---------- stlimp: C# ----------
   /*
    original VB.net code by Ola Jaensson
    found on http://www.grasshopper3d.com/forum/topics/import-an-stl-file-direct-in-grasshopper

    C# adaptation by Alessio Erioli - Co-de-iT 2017
    
    known bugs:
    
    . welding here de-syncs vertex and color order in Processing


    */

    initComp();


    if (wA == 0) wA = Math.PI;

    byte[] stl = System.IO.File.ReadAllBytes(F);
    Print("File length: " + stl.Length + " bytes");
    long numtris = BitConverter.ToInt32(stl, 80);
    Print("Number of triangles: " + numtris);
    int c = 0;
    int pos = 0;
    Mesh tempmesh = new Mesh();
    Vector3f tempvect = default(Vector3f);
    if (numtris * 50 + 84 == stl.Length) {
      Print("STL file length matches the number of triangle faces");
      for (c = 0; c <= numtris - 1; c++) {
        pos = c * 50 + 84;
        tempvect = readVect3f(ref stl, ref pos);
        Mesh _with1 = tempmesh;
        _with1.Vertices.SetVertex(c * 3, readPoint3f(ref stl, ref pos));
        _with1.Vertices.SetVertex(c * 3 + 1, readPoint3f(ref stl, ref pos));
        _with1.Vertices.SetVertex(c * 3 + 2, readPoint3f(ref stl, ref pos));
        _with1.Faces.SetFace(c, c * 3, c * 3 + 1, c * 3 + 2);
        _with1.Normals.SetNormal(c * 3, tempvect);
        _with1.Normals.SetNormal(c * 3 + 1, tempvect);
        _with1.Normals.SetNormal(c * 3 + 2, tempvect);
      }
      tempmesh.Weld(wA);
    } else {
      Print("STL file length does not match the number of triangle faces");
    }
    M = tempmesh;
# ---------- stlimp: C# additional code ----------
  void initComp(){
    Component.Name = "STL import";
    Component.NickName = "STLimp";
    Component.Description = "import an STL mesh";
    Component.Params.Input[0].Name = "File name and path";
    Component.Params.Input[0].Description = "the input file path";
    Component.Params.Input[1].Name = "Weld Angle";
    Component.Params.Input[1].Description = "the weld angle";
    Component.Params.Output[0].Name = "info";
    Component.Params.Output[0].Description = "Result of import operation";
    Component.Params.Output[1].Name = "Mesh";
    Component.Params.Output[1].Description = "The imported Mesh";
  }

  private float readSingle(ref byte[] stl, ref int pos)
  {
    float functionReturnValue = 0;
    functionReturnValue = BitConverter.ToSingle(stl, pos);
    pos = pos + 4;
    return functionReturnValue;
  }

  private Vector3f readVect3f(ref byte[] stl, ref int pos)
  {
    return new Vector3f(readSingle(ref stl, ref pos), readSingle(ref stl, ref pos), readSingle(ref stl, ref pos));
  }

  private Point3f readPoint3f(ref byte[] stl, ref int pos)
  {
    return new Point3f(readSingle(ref stl, ref pos), readSingle(ref stl, ref pos), readSingle(ref stl, ref pos));
  }
# ---------- end stlimp ----------
crv_4 = Curve(filter)

# ----
# field curves
panel_2 = Panel("3")
previewlw = CustomPreviewLineweights(Geometry=crv_4, Shader=ColourSwatch(SwatchColor=RGB(255, 255, 255)), Thickness=panel_2, Absolute=False)

mesh = Mesh()
panel_3 = Panel(stlimp.info)
demesh = DeconstructMesh(Mesh=stlimp.M)  # -> Vertices, Faces, Colours, Normals
lng = ListLength(List=demesh.Vertices)  # -> expr("x-1", Length)
random_2 = Random(Range=lng, Number=number_slider, Seed=2, Integers=True)
item = ListItem(List=demesh.Vertices, Index=random_2, Wrap=True)
item_2 = ListItem(List=demesh.Normals, Index=random_2, Wrap=True)
pl = PlaneNormal(Origin=item, ZAxis=item_2)
fspin = SpinForce(Plane=pl, Strength=random, Radius=5, Decay=Slider(0.25, range=0.01..2))
mergef = MergeFields(Fields=fspin)
lng_2 = ListLength(List=demesh.Vertices)  # -> expr("x-1", Length)
evf = EvaluateField(Field=mergef, Point=demesh.Vertices)  # -> Tensor, Strength
multiplication = Multiplication(A=lng_2, B=Slider(0.016, range=0..1))
unit = UnitVector(Vector=evf.Tensor)
int = Integer(multiplication)
xprod = CrossProduct(VectorA=unit, VectorB=demesh.Normals, Unitize=True)  # -> Vector, Length
random_3 = Random(Range=lng_2, Number=int, Seed=2, Integers=True)
n_of_random_agents = Panel(int)
n_directions = Panel("4")
vector_field = ValueList({"continuous": 0, "cont. rotated": 1, "discrete": 2, "from charges": 3}, selected="from charges")
item_3 = ListItem(List=demesh.Vertices, Index=random_3, Wrap=True)

# ---- group: points
pt = Point(demesh.Vertices)

# ---- group: field direction
field_direction = FieldDirection(points=pt, polylines=crv_4)  # -> vectors, planes

# ---- group: disctretize vectors
discretize_vectors = DiscretizeVectors(vectors=field_direction.vectors, n_of_directions=n_directions)  # -> discretized_vectors, discretized_vector_grouped_by_direction

# ----
xprod_2 = CrossProduct(VectorA=field_direction.vectors, VectorB=demesh.Normals, Unitize=False)  # -> Vector, Length
filter_2 = StreamFilter(
    Gate=vector_field,
    Stream0=field_direction.vectors,
    Stream1=xprod_2.Vector,
    Stream2=discretize_vectors.discretized_vectors,
    Stream3=xprod.Vector)
item_4 = ListItem(List=filter_2, Index=random_3, Wrap=True)

# ---- group: vectors
vec = Vector(filter_2)

# ---- group: agents positions
pt_2 = Point(item_3)

# ---- group: agents velocities
vec_2 = Vector(item_4)

# ----
msphere = MeshSphere(Base=pt_2, Radius=Slider(4.813, range=0..5), UCount=10, VCount=20)

color = ValueList({"mono": 0, "by N dir": 1}, selected="by N dir")
multiplication_2 = Multiplication(A=Slider(8, range=1..100), B=vec)
unit_2 = UnitVector(Vector=vec)
# field visualization
filter_3 = StreamFilter(Gate=color, Stream0=ColourSwatch(SwatchColor=RGB(150, 229, 235)), Stream1=unit_2)
vdisex = VectorDisplayEx(Point=pt, Vector=multiplication_2, Colour=filter_3, Width=2)

previewmat = CustomPreviewMaterials(Geometry=msphere, DiffuseColor=RGB(255, 255, 255))

custom_subdir_2 = Panel("GH_2_P5\data")
dir_type_2 = ValueList({"desktop": 0, "documents": 1, "GH file path": 2, "C:": 3}, selected="GH file path")
f_pathg_2 = PathGenerator(type=dir_type_2, subDir=custom_subdir_2)  # -> dir; inputs type: Int32, subDir: String; same code as f_pathg
# export field
destination_directory = Panel(f_pathg_2)

expression = Expression(P=pt, Expression="Format(\"{0},{1},{2}\",P.x,P.y,P.z)")
expression_2 = Expression(P=vec, Expression="Format(\"{0},{1},{2}\",P.x,P.y,P.z)")
type = Panel("0")
expression_3 = Expression(p=expression, v=expression_2, t=type, Expression="Format(\"{0} {1} {2}\", p, v,t)")
txt = Text(flatten(expression_3))
file_name_extension_2 = Panel("field.txt")
save = Button()
f_str2file = SaveStringToFile(S=txt, dir=f_pathg_2, file=file_name_extension_2, save=save)  # -> info; inputs S: list of String, dir: String, file: String, save: Boolean
# ---------- f_str2file: C# ----------
                           /*
    froGH - a sparse collection of (in)utilities for Grasshopper

    Save string to file

    code by Alessio Erioli

    froGH by Co-de-iT is licensed under a Creative Commons Attribution 4.0 International License.
    http://creativecommons.org/licenses/by/4.0/

    */

    initComp();



    if (save){
      if (!Directory.Exists(dir)) Directory.CreateDirectory(dir);

      String target = dir + file;

      System.IO.File.WriteAllLines(target, S.ToArray());
      info = "file saved as: " + target;
    } else {
      info = "press save button to save file";
    }
# ---------- f_str2file: C# additional code ----------
  void initComp(){
    Component.Name = "Save String to File";
    Component.NickName = "f_Str2File";
    Component.Description = "Saves a text sequence to a file";

    Component.Params.Input[0].Name = "String";
    Component.Params.Input[0].Description = "string to save (as List)";
    Component.Params.Input[1].Name = "directory";
    Component.Params.Input[1].Description = "directory where the string file is saved";
    Component.Params.Input[2].Name = "fileName";
    Component.Params.Input[2].Description = "file name and extension (ex: myText.txt)";
    Component.Params.Input[3].Name = "save";
    Component.Params.Input[3].Description = "activate saving - attach a button and click to save";
    Component.Params.Output[0].Name = "info";
    Component.Params.Output[0].Description = "information on the saving process";
  }
# ---------- end f_str2file ----------

custom_subdir_3 = Panel("GH_2_P5\data")
dir_type_3 = ValueList({"desktop": 0, "documents": 1, "GH file path": 2, "C:": 3}, selected="GH file path")
f_pathg_3 = PathGenerator(type=dir_type_3, subDir=custom_subdir_3)  # -> dir; inputs type: Int32, subDir: String; same code as f_pathg
# export agents
destination_directory_2 = Panel(f_pathg_3)

expression_4 = Expression(P=pt_2, Expression="Format(\"{0},{1},{2}\",P.x,P.y,P.z)")
expression_5 = Expression(P=vec_2, Expression="Format(\"{0},{1},{2}\",P.x,P.y,P.z)")
type_2 = Panel("0")
expression_6 = Expression(p=expression_4, v=expression_5, t=type_2, Expression="Format(\"{0} {1} {2}\", p, v,t)")
txt_2 = Text(flatten(expression_6))
file_name_extension_3 = Panel("agents.txt")
save_2 = Button()
f_str2file_2 = SaveStringToFile(S=txt_2, dir=f_pathg_3, file=file_name_extension_3, save=save_2)  # -> info; inputs S: list of String, dir: String, file: String, save: Boolean; same code as f_str2file

# ==== cluster FieldDirection
points = ClusterInput()
polylines = ClusterInput()
crv = Curve(reparameterize(flatten(polylines)))
explode = Explode(Curve=crv, Recursive=True)  # -> reparameterize(Segments), Vertices
pt = Point(flatten(points))
vec = Vector(explode.Segments)
bishift = DoubleShift(list=vec, wrap="False")  # -> graft(no_last), graft(no_first)
xprod = CrossProduct(VectorA=bishift.no_first, VectorB=bishift.no_last, Unitize=False)  # -> Vector, Length
pshift = ShiftPaths(Data=xprod.Vector, Offset=-1)
item = ListItem(List=pshift, Index=0, Wrap=True)  # -> Item1, Item
lng = ListLength(List=flatten(explode.Segments))
merge = Merge(Data1=item.Item, Data2=pshift, Data3=item.Item1)
series = Series(Start=0, Step=1, Count=lng)
crv_cp = CurveClosestPoint(Point=graft(pt), Curve=flatten(explode.Segments))  # -> Point, Parameter, Distance
bishift_2 = DoubleShift(list=merge, wrap="False")  # -> graft(no_last), graft(no_first)
int = Integer(series)
merge_2 = Merge(Data1=bishift_2.no_last, Data2=bishift_2.no_first)
sort = SortList(Keys=crv_cp.Distance, ValuesA=crv_cp.Parameter, ValuesB=int, ValuesC=crv_cp.Point)  # -> Keys, ValuesA, ValuesB, ValuesC
group = Group(Objects=merge_2)  # -> flatten(Group)
item_2 = ListItem(List=sort.ValuesC, Index=0, Wrap=True)  # -> flatten(Item)
item_3 = ListItem(List=sort.ValuesA, Index=0, Wrap=True)
item_4 = ListItem(List=sort.ValuesB, Index=0, Wrap=True)
item_5 = ListItem(List=group, Index=item_4, Wrap=True)
vec2pt = Vector2Pt(PointA=pt, PointB=item_2, Unitize=False)  # -> Vector, Length
ungroup = Ungroup(Group=item_5)
interp = InterpolateData(Data=ungroup, Parameter=item_3, Interpolation=2)  # -> flatten(Value)
pl = ConstructPlane(Origin=pt, XAxis=vec2pt.Vector, YAxis=interp)
xprod_2 = CrossProduct(VectorA=vec2pt.Vector, VectorB=interp, Unitize=True)  # -> Vector, Length
vectors = ClusterOutput(xprod_2.Vector)
planes = ClusterOutput(pl)

# ==== cluster DiscretizeVectors
vectors = ClusterInput()
n_of_directions = ClusterInput()
one_over_x = OneOverX(Value=n_of_directions)
panel = Panel(one_over_x)
pi = Pi(Factor=panel)
X = UnitX(Factor=1)
Z = UnitZ(Factor=1)
vrot = Rotate(Vector=X, Axis=Z, Angle=pi)
xy = XYPlane(Origin=Point(0, 0, 0))
angle = Angle(VectorA=vectors, VectorB=vrot, Plane=xy)  # -> Angle, Reflex
pi_2 = Pi(Factor="2")
remap = RemapNumbers(Value=angle.Reflex, Source="0 to 2*Pi", Target=Domain(0, 1))  # -> Mapped, Clipped
Y = UnitY(Factor=1)
range = Range(Domain=pi_2, Steps=n_of_directions)
Z_2 = UnitZ(Factor=1)
multiplication = Multiplication(A=remap.Clipped, B=n_of_directions)
vrot_2 = Rotate(Vector=Y, Axis=Z_2, Angle=range)
expression = Expression(x=multiplication, Expression="floor(x)")
cull_i = CullIndex(List=vrot_2, Indices="-1", Wrap=True)
item = ListItem(List=cull_i, Index=graft(expression), Wrap=True)  # -> flatten(Item)

# ----
# group indexes by direction
series = Series(Start=0, Step=1, Count=n_of_directions)
int = Integer(series)
mindex = MemberIndex(Set=expression, Member=int)  # -> Index, Count

discretized_vectors = ClusterOutput(item)
discretized_vector_grouped_by_direction = ClusterOutput(mindex.Index)

# ==== cluster DoubleShift: Shifts a list +1 and -1, wrap option available
list = ClusterInput()
wrap = ClusterInput()
shift = ShiftList(List=list, Shift=1, Wrap=wrap)
shift_2 = ShiftList(List=list, Shift="-1", Wrap=wrap)
no_last = ClusterOutput(shift_2)
no_first = ClusterOutput(shift)
