# Grasshopper definition 1_3_0_import bodies.gh (Grasshopper 0.9.76)
# Copyright: Co-de-iT
# plug-ins: Human, Mesh Pipe

F = File("F:\Users\alessio\Documents\Processing\sketches\P5_Paris_DesignByData\Workflows\wf_01\P5_2_GH\0465Y_struct.txt")
# drag here the .txt file from
# 
# P5_2_GH
file = ReadFile(File=F, PerLineParse=True)
panel = Panel(F)
point_separator_space = Panel(" ")
split = TextSplit(Text=file, Separators=point_separator_space)
split_2 = SplitList(List=split, Index="1")  # -> ListA, ListB
pt = Point(split_2.ListA)
pt_2 = Point(split_2.ListB)
ln = Line(StartPoint=pt, EndPoint=pt_2)
tstat = TreeStatistics(Tree=ln)  # -> Paths, Length, Count
join = JoinCurves(Curves=flatten(ln), Preserve=False)  # disabled
range = Range(Domain=Domain(0, 1), Steps=expr("x-1", tstat.Count))
gradient = Gradient(LowerLimit=0, UpperLimit=1, Parameter=range, stops=[0.0345: RGB(137, 205, 240), 0.98: RGB(14, 26, 76)])
mpipe = MeshPipe(Curve=join, Radius=Slider(1, range=0.01..1), Accuracy=0.2, Rotation=0, Segments="3", Caps=2)
mjoin = MeshJoin(Meshes=mpipe)
preview = CustomPreview(Geometry=ln, Shader=graft(gradient))
previewmat = CustomPreviewMaterials(Geometry=mjoin, DiffuseColor=RGB(255, 255, 255))
