# Grasshopper definition 2_3_0_import bodies_types.gh (Grasshopper 0.9.76)
# Copyright: Co-de-iT
# plug-ins: Mesh Pipe

# drag here the .txt file from
# 
# P5_2_GH
file = ReadFile(
    File="F:\Users\alessio\Documents\Processing\sketches\P5_Paris_DesignByData\Workflows\wf_02\P5_2_GH\2203Y_struct_topo.txt",
    PerLineParse=True)
argument_separator = Panel("_")
split = TextSplit(Text=file, Separators=argument_separator)
point_separator = Panel(" ")
item = ListItem(List=split, Index=0, Wrap=True)  # -> Item, Item1, Item2
agent_number = Panel(item.Item)
body_type = Panel(item.Item1)
split_2 = TextSplit(Text=item.Item2, Separators=point_separator)
split_3 = SplitList(List=split_2, Index="1")  # -> ListA, ListB
lng = ListLength(List=flatten(agent_number))  # -> expr("x-1", Length)
pt = Point(split_3.ListB)
pt_2 = Point(split_3.ListA)
range = Range(Domain=Domain(0, 1), Steps=lng)  # -> graft(Range)
ln = Line(StartPoint=pt_2, EndPoint=pt)  # -> simplify(Line)
expression = Expression(a=agent_number, b=body_type, Expression="Format(\"{0}_{1}\", a, b)")
join = JoinCurves(Curves=flatten(ln), Preserve=False)
item_2 = ListItem(List=ln, Index=0, Wrap=True)  # -> Item, Item1
pl = ConstructPlane(Origin=pt_2, XAxis=item_2.Item, YAxis=item_2.Item1)
gradient = Gradient(LowerLimit=0, UpperLimit=1, Parameter=range, stops=[0.0345: RGB(137, 205, 240), 0.98: RGB(14, 26, 76)])
mpipe = MeshPipe(Curve=join, Radius=Slider(1, range=0..1), Accuracy=0.2, Rotation=0, Segments="4", Caps="1")
mjoin = MeshJoin(Meshes=mpipe)
preview = CustomPreview(Geometry=ln, Shader=gradient)
preview_2 = CustomPreview(Geometry=mjoin, Shader=ColourSwatch(SwatchColor=RGB(145, 129, 35)))
tag = TextTag3D(Location=pl, Text=expression, Size=Slider(3, range=0..10), Justification=7)
